# Grasshopper definition 20160320_single_beam_geometry_definition.gh (Grasshopper 0.9.76)
# plug-ins: Python Interpreter, TMarsupilami

N = Slider(20, range=0..100)

list = ValueList({"symetric": 1, "antisymetric": -1}, selected="antisymetric")
a = Slider(10, range=5..20)
ouverture = Slider(30, range=0..90)
twist = Slider(32, range=-45..45)

b1 = Slider(0.15, range=0.01..0.5)
b2 = Slider(0.45, range=0..0.5)

twistmodulo = Slider(0, range=-2..2)

elongation = Slider(1, range=0.5..1.5)
theta_0 = Slider(0, range=-20..20)

vdisex = VectorDisplayEx(Colour=RGB(0, 0, 0), Width=2)
vdis = VectorDisplay()
division = Division(A=N, B=3)
beam_setup = BeamSetup(
    N=N,
    section_b1=b1,
    section_b2=b2,
    initial_a=a,
    initial_ouverture=ouverture,
    initial_twist=twist,
    initial_twistmodulo=twistmodulo,
    intial_symetric=list,
    repos_epsilon=elongation,
    repos_theta=theta_0)  # -> section_xy, planes_0_2, planes_i_2
int = Integer(division)

N_2 = Slider(12, range=0..100)
section_b1 = Number(b1)
section_b2 = Number(b2)
subtraction = Subtraction(A=N, B=int)
repeat = RepeatData(Data=section_b1, Length=int)
repeat_2 = RepeatData(Data=section_b1, Length=subtraction)
repeat_3 = RepeatData(Data=section_b2, Length=int)
repeat_4 = RepeatData(Data=section_b2, Length=subtraction)
division_2 = Division(A=repeat_2, B=1)
division_3 = Division(A=repeat_4, B=1.25)

cluster = Cluster_2(pln=beam_setup.planes_i_2)
section_b1_2 = Number([repeat, division_2])
section_b2_2 = Number([repeat_3, division_3])
dom = ConstructDomain(DomainStart=expr("-x/2", section_b2_2), DomainEnd=expr("x/2", section_b2_2))
dom_2 = ConstructDomain(DomainStart=expr("-x/2", section_b1_2), DomainEnd=expr("x/2", section_b1_2))
rectangle = Rectangle(Plane=PlaneXY(0, 0, 0), XSize=dom_2, YSize=dom, Radius=0)  # -> Section_XY, Length

# ---- group: Beam A
sections_i = Plane(cluster)
section_b1_3 = Number([repeat, division_2])
section_b2_3 = Number([repeat_3, division_3])
section_xy = Curve(rectangle.Section_XY)
sections_0 = Plane(beam_setup.planes_0_2)

# ----
item = ListItem(List=sections_i, Index=-1, Wrap=True)
item_2 = ListItem(List=sections_i, Index=0, Wrap=True)
geom = DefineBeamGeometrySingle(StartFrame=item_2, EndFrame=item, EdgeCount=N, TwistModulo=Slider(1, range=-2..2))  # -> Centerline, Frames
mpoint = Point(geom.Frames)
cull_i = CullIndex(List=geom.Frames, Indices=[0, -1], Wrap=True)
item_3 = ListItem(List=geom.Frames, Index=[0, -1], Wrap=True)
crv = Curve(geom.Centerline)
reldif = RelativeDifferences(Values=mpoint)
fdis = FrameDisplay(Frame=item_3, ScaleFactor=4, LineWidth=3, Color=[RGB(0, 0, 255), RGB(255, 0, 0), RGB(0, 255, 0)])
fdis_2 = FrameDisplay(Frame=cull_i, ScaleFactor=1, LineWidth=[2, 1, 1], Color=[RGB(0, 0, 255), RGB(255, 0, 0), RGB(0, 255, 0)])
num = Number(reldif)
az = ZAngleBetweenPlanesRotation(Planes=sections_i)
pln = Plane(geom.Frames)
az_2 = ZAngleBetweenPlanesRotation(Planes=geom.Frames)
cull_i_2 = CullIndex(List=num, Indices=0, Wrap=True)
division_4 = Division(A=az_2, B=cull_i_2)

colors = Colour([RGB(0, 0, 255), RGB(255, 255, 255)])
section_xy_2 = Curve(section_xy)
sections_0_2 = Plane(sections_0)
sections_i_2 = Plane(pln)
beam_preview = BeamPreview(colors=colors, section=section_xy_2, mframe=sections_0_2)
beam_preview_2 = BeamPreview(colors=colors, section=section_xy_2, mframe=sections_i_2)
frames = Frames(L=sections_i_2, scale=1, W=1)
end_frames = EndFrames(L=sections_i_2, scale=2, W=3)

python = PythonScript(section=section_xy, mframe=pln)  # -> out, brep; inputs section: list of Curve, mframe: list of Plane
# ---------- python: Python ----------
import rhinoscriptsyntax as rs
import Rhino as rh

n = len(mframe)
pts = []

# create centerline
for i in range(n):
    pts.append(mframe[i].Origin)
centerline = rh.Geometry.Curve.CreateControlPointCurve(pts)

# split centerline
t = []
for pt in pts:
    t.append(rs.CurveClosestPoint(centerline, pt))
rails = centerline.Split(t)

brep = []
for i in range(n-1):
    xform = rh.Geometry.Transform.PlaneToPlane(rh.Geometry.Plane.WorldXY, mframe[i])
    shape = section[i]
    shape.Transform(xform)
    rail = rails[i]
    
    brep.append(rh.Geometry.Brep.CreateFromSweep(rail, shape, True, 1e-5)[0])



print t
# ---------- end python ----------
dist = Distance(PointA=sections_i, PointB=geom.Frames)  # -> expr("x*1e14", Distance)
multiplication = Multiplication(A=division_4, B=1e+14)
fdis_3 = FrameDisplay(Frame=sections_i, ScaleFactor=1, LineWidth=[2, 1, 1], Color=[RGB(0, 0, 255), RGB(255, 0, 0), RGB(0, 255, 0)])
panel = Panel(multiplication)

# ==== cluster BeamSetup
N = ClusterInput()
section_b1 = ClusterInput()
section_b2 = ClusterInput()
initial_a = ClusterInput()
initial_ouverture = ClusterInput()
initial_twist = ClusterInput()
initial_twistmodulo = ClusterInput()
intial_symetric = ClusterInput()
repos_epsilon = ClusterInput()
repos_theta = ClusterInput()
initial_twistmodulo_2 = Number(initial_twistmodulo)
initial_ouverture_2 = Number(initial_ouverture)
intial_symetric_2 = Integer(intial_symetric)
repos_epsilon_2 = Number(repos_epsilon)
repos_theta_2 = Number(repos_theta)
initial_twist_2 = Number(initial_twist)
section_b1_2 = Number(section_b1)
section_b2_2 = Number(section_b2)
initial_a_2 = Number(initial_a)
N_2 = Number(N)

dom = ConstructDomain(DomainStart=expr("-x/2", section_b2_2), DomainEnd=expr("x/2", section_b2_2))
dom_2 = ConstructDomain(DomainStart=expr("-x/2", section_b1_2), DomainEnd=expr("x/2", section_b1_2))
rectangle = Rectangle(Plane=PlaneXY(0, 0, 0), XSize=dom_2, YSize=dom, Radius=0)  # -> Section_XY, Length
explode = Explode(Curve=rectangle.Section_XY, Recursive=True)  # -> simplify(Segments), Vertices

cluster = Cluster(X=initial_a_2, Z=0)  # -> pt_6, pt_4, pt_5

lng = ListLength(List=explode.Segments)
col = Colour([RGB(0, 0, 255), RGB(255, 255, 255)])
repeat = RepeatData(Data=col, Length=lng)

# ---- group: CONFIG : START / OUVERTURE
angle = Number(initial_ouverture_2)
pt = Point(cluster.pt_6)
pt_2 = Point(cluster.pt_5)
pl = ConstructPlane(Origin=pt, XAxis=expr("{0,0,1}", Vector(78.26149335, 0, 0)), YAxis=expr("{0,-1,0}", Vector(0, 1, 0)))
pl_2 = ConstructPlane(Origin=pt_2, XAxis=expr("{0,0,1}", Vector(78.26149335, 0, 0)), YAxis=expr("{0,-1,0}", Vector(0, 1, 0)))
deplane = DeconstructPlane(Plane=pl)  # -> Origin, XAxis, YAxis, ZAxis
deplane_2 = DeconstructPlane(Plane=pl_2)  # -> Origin, XAxis, YAxis, ZAxis
rot3d = Rotate3D(Geometry=pl_2, Angle=expr("-x", degrees(angle)), Center=deplane_2.Origin, Axis=deplane_2.YAxis)  # -> Geometry, Transform
rot3d_2 = Rotate3D(Geometry=pl, Angle=degrees(angle), Center=deplane.Origin, Axis=deplane.YAxis)  # -> Geometry, Transform

# ---- group: CONFIG : START / TWIST
angle_2 = Number(initial_twist_2)
pln = Plane(rot3d.Geometry)
pln_2 = Plane(rot3d_2.Geometry)
deplane_3 = DeconstructPlane(Plane=pln_2)  # -> Origin, XAxis, YAxis, ZAxis
deplane_4 = DeconstructPlane(Plane=pln)  # -> Origin, XAxis, YAxis, ZAxis
multiplication = Multiplication(A=angle_2, B=intial_symetric_2)
rot3d_3 = Rotate3D(Geometry=pln, Angle=expr("-x", degrees(multiplication)), Center=deplane_4.Origin, Axis=expr("{0,0,1}", Vector(0, 0, 1)))  # -> Geometry, Transform
rot3d_4 = Rotate3D(Geometry=pln_2, Angle=degrees(angle_2), Center=deplane_3.Origin, Axis=expr("{0,0,1}", Vector(0, 0, 1)))  # -> Geometry, Transform

# ---- group: CONFIG : START
pln_3 = Plane(rot3d_4.Geometry)
pln_4 = Plane(rot3d_3.Geometry)
deplane_5 = DeconstructPlane(Plane=pln_3)  # -> Origin, XAxis, YAxis, ZAxis
deplane_6 = DeconstructPlane(Plane=pln_4)  # -> Origin, XAxis, YAxis, ZAxis
intcrv_t = InterpolateT(
    Vertices=[deplane_5.Origin, deplane_6.Origin],
    Degree=3,
    TangentStart=deplane_5.ZAxis,
    TangentEnd=deplane_6.ZAxis,
    KnotStyle=0)  # -> Curve, Length, Domain

divide = DivideCurve(Curve=intcrv_t.Curve, Count=N_2, Kinks=False)  # -> Points, Tangents, Parameters
beam_geo = BeamGeometry(StartSection=pln_3, EndSection=pln_4, CenterlinePositions=divide.Points, TwistModulo=initial_twistmodulo_2)  # -> PT, sections, twist_closure, t, l, ll, kb
planes_i = Plane(beam_geo.sections)

# ---- group: CONFIG : REST
pline = PolyLine(Vertices=divide.Points, Closed=False)
explode_2 = Explode(Curve=pline, Recursive=True)  # -> Segments, Vertices
len = Length(Curve=pline)
len_2 = Length(Curve=explode_2.Segments)
multiplication_2 = Multiplication(A=len_2, B=repos_epsilon_2)
ma = MassAddition(Input=multiplication_2)  # -> Result, PartialResults
pt_3 = ConstructPoint(XCoordinate=expr("-x/2", len), YCoordinate=0, ZCoordinate=0)
X = UnitX(Factor=ma.PartialResults)
move = Move(Geometry=pt_3, Motion=X)  # -> Geometry, Transform
pline_2 = PolyLine(Vertices=flatten([pt_3, move.Geometry]), Closed=False)  # -> reparameterize(Polyline)

alpha = Slider(0, range=-90..90)
unit = UnitVector(Vector=X)
pframe = PerpFrame(Curve=pline_2, Parameter=0)
pt_plane = ParallelTransportAPlane(Plane=pframe, Points=move.Geometry, Vectors=unit, Alpha=expr("Rad(x)", alpha), Theta=expr("Rad(x)", repos_theta_2))
planes_0 = Plane(pt_plane)

# ---- group: 3D
orient = Orient(Geometry=graft(explode.Segments), Source=PlaneXY(0, 0, 0), Target=planes_0)  # -> Geometry, Transform
geo = Geometry(orient.Geometry)
swp1 = Sweep1(Rail=pline_2, Sections=simplify(geo), Miter=1)  # -> simplify(Brep)
preview = CustomPreview(Geometry=swp1, Shader=simplify(graft(repeat)))

orient_2 = Orient(Geometry=graft(explode.Segments), Source=PlaneXY(0, 0, 0), Target=planes_i)  # -> Geometry, Transform
geo_2 = Geometry(orient_2.Geometry)
swp1_2 = Sweep1(Rail=intcrv_t.Curve, Sections=simplify(geo_2), Miter=1)  # -> simplify(Brep)
preview_2 = CustomPreview(Geometry=swp1_2, Shader=simplify(graft(repeat)))

# ----
deplane_7 = DeconstructPlane(Plane=planes_i)  # -> Origin, XAxis, YAxis, ZAxis
pline_3 = PolyLine(Vertices=deplane_7.Origin, Closed=False)
planes_i_2 = ClusterOutput(planes_i)
section_xy = ClusterOutput(rectangle.Section_XY)
planes_0_2 = ClusterOutput(planes_0)

# ==== cluster BeamPreview
section = ClusterInput()
colors = ClusterInput()
mframe = ClusterInput()
python = PythonScript(section=section, mframe=mframe)  # -> out, brep, rails, shapes; inputs section: list of Curve, mframe: list of Plane
# ---------- python: Python ----------
import rhinoscriptsyntax as rs
import Rhino as rh

n = len(mframe)
pts = []

# create centerline
for i in range(n):
    pts.append(mframe[i].Origin)
centerline = rh.Geometry.Curve.CreateControlPointCurve(pts)

# split centerline
t = []
for pt in pts:
    t.append(rs.CurveClosestPoint(centerline, pt))
rails = centerline.Split(t)

brep = []
shapes = []
for i in range(n-1):
    shape1 = section[i].Duplicate()
    shape1.Transform(rh.Geometry.Transform.PlaneToPlane(rh.Geometry.Plane.WorldXY, mframe[i]))
    shape2 = section[i].Duplicate()
    shape2.Transform(rh.Geometry.Transform.PlaneToPlane(rh.Geometry.Plane.WorldXY, mframe[i+1]))
    rail = rails[i]
    shapes.append(shape1)
    shapes.append(shape2)
    
    brep.append(rh.Geometry.Brep.JoinBreps(rh.Geometry.Brep.CreateFromSweep(rail, [shape1,shape2], True, 1e-6), 1e-6)[0])
    


print t
# ---------- end python ----------
preview = CustomPreview(Geometry=python.brep, Shader=simplify(graft(ColourSwatch(SwatchColor=RGB(87, 128, 255)))))

# ==== cluster EndFrames
L = ClusterInput()
scale = ClusterInput()
W = ClusterInput()
item = ListItem(List=L, Index=[0, -1], Wrap=True)
deplane = DeconstructPlane(Plane=item)  # -> Origin, XAxis, YAxis, ZAxis
scale_2 = Number(scale)
W_2 = Integer(W)
G = Point(deplane.Origin)
d2 = Vector(deplane.YAxis)
d1 = Vector(deplane.XAxis)
d3 = Vector(deplane.ZAxis)
multiplication = Multiplication(A=d3, B=scale_2)
multiplication_2 = Multiplication(A=d1, B=scale_2)
multiplication_3 = Multiplication(A=d2, B=scale_2)
vdisex = VectorDisplayEx(Point=G, Vector=multiplication, Colour=RGB(0, 0, 255), Width=W_2)
vdisex_2 = VectorDisplayEx(Point=G, Vector=multiplication_2, Colour=RGB(255, 0, 0), Width=W_2)
vdisex_3 = VectorDisplayEx(Point=G, Vector=multiplication_3, Colour=RGB(0, 255, 0), Width=W_2)

# ==== cluster Frames
L = ClusterInput()
scale = ClusterInput()
W = ClusterInput()
cull_i = CullIndex(List=L, Indices=[0, -1], Wrap=True)
deplane = DeconstructPlane(Plane=cull_i)  # -> Origin, XAxis, YAxis, ZAxis
scale_2 = Number(scale)
W_2 = Integer(W)
G = Point(deplane.Origin)
d2 = Vector(deplane.YAxis)
d1 = Vector(deplane.XAxis)
d3 = Vector(deplane.ZAxis)
multiplication = Multiplication(A=d3, B=scale_2)
multiplication_2 = Multiplication(A=d1, B=scale_2)
multiplication_3 = Multiplication(A=d2, B=scale_2)
vdisex = VectorDisplayEx(Point=G, Vector=multiplication, Colour=RGB(0, 0, 255), Width=W_2)
vdisex_2 = VectorDisplayEx(Point=G, Vector=multiplication_2, Colour=RGB(255, 0, 0), Width=W_2)
vdisex_3 = VectorDisplayEx(Point=G, Vector=multiplication_3, Colour=RGB(0, 255, 0), Width=W_2)

# ==== cluster Cluster_2
pln = ClusterInput()

pln_2 = Plane(pln)
item = ListItem(List=pln_2, Index=0, Wrap=True)
vec2pt = Vector2Pt(PointA=item, PointB=Point(0, 0, 0), Unitize=False)  # -> Vector, Length
move = Move(Geometry=pln_2, Motion=vec2pt.Vector)  # -> Geometry, Transform

G = ClusterOutput(move.Geometry)

# ==== cluster Cluster
X = ClusterInput()
Z = ClusterInput()
pt = ConstructPoint(XCoordinate=expr("x/2", X), YCoordinate=0, ZCoordinate=0)
pt_2 = ConstructPoint(XCoordinate=expr("-x/2", X), YCoordinate=0, ZCoordinate=0)
pt_3 = ConstructPoint(XCoordinate=0, YCoordinate=0, ZCoordinate=Z)
pt_4 = ClusterOutput(pt_3)
pt_5 = ClusterOutput(pt)
pt_6 = ClusterOutput(pt_2)
